# Grasshopper definition Curvature_analysis.gh (Grasshopper 1.0.7)

density = Slider(0.471, range=0.1..2)
ratio = Slider(3.962, range=1..10)
crv = Curve([<curve referenced from the Rhino model> x4])

crv_2 = Curve(graft(crv))
len = Length(Curve=crv_2)
division = Division(A=len, B=density)
divide = DivideCurve(Curve=crv_2, Count=division, Kinks=False)  # -> Points, Tangents, Parameters
curvature = Curvature(Curve=crv_2, Parameter=divide.Parameters)  # -> P, K, C
darc = DeconstructArc(Arc=curvature.C)  # -> BasePlane, Radius, Angle
division_2 = Division(A=darc.Radius, B=ratio)
frame = CurveFrame(Curve=crv_2, Parameter=divide.Parameters)
concat = Concatenate(FragmentA="0.0 To ", FragmentB=division_2)
rectangle = Rectangle(Plane=frame, XSize=Domain(0, 0), YSize=concat, Radius=0)  # -> Rectangle, Length
explode = Explode(Curve=rectangle.Rectangle, Recursive=True)  # -> Segments, Vertices
item = ListItem(List=explode.Segments, Index=1, Wrap=True)  # -> simplify(Item)
end = EndPoints(Curve=item)  # -> Start, End
path_mapper = PathMapper(end.End, source="{A;B}", target="{A}")
pt = Point(path_mapper)
pline = PolyLine(Vertices=pt, Closed=False)

crv_3 = Curve(item)
crv_4 = Curve(pline)
viewer = ParamViewer()
